# Dynamo graph PAR_NL-SfB_family.dyn (Dynamo 2.12.1.8246)
# packages: Data-Shapes 2019.2.42, Orchid 230.0.2.7458, DYN_SharedParamTesting 1.0.0

# group: get Familyname
current = Document.Current()
filePath = Document.FilePath(document=current)
string = StringInput("\")
split = String.Split(string=filePath, separator0=string)
lastItem = List.LastItem(list=split)

# group: Wipe Ass
# note: Custom Node: Orchidv.212.3.0.8293
all = Orchid.RevitFamily.FamilyType.All()
code_block = CodeBlock { "Assembly Code"; ""; }
setValue = Orchid.RevitFamily.FamilyParameter.SetValue(familyDocument=current, familyType=all, parameterName=code_block.out0, value=code_block.out1)

# group: Set correct shared parameterfile and add ClassificationCode(4)
classificationCode = StringInput("ClassificationCode(4)")  # graph input
code_block_2 = CodeBlock { "IFC Properties"; "PG_IDENTITY_DATA"; }
boolean = BoolSelector(true)
# note: Custom Node: Dyn_SharedParamTestingv.1.0.0
addSharedParamsToFamily = RBG_VSNodes.Document.AddSharedParamsToFamily(SPParameterName=classificationCode, SPGroupName=code_block_2.out0, IsInstance=boolean)  # unwired: BuiltInPG

# group: Set IFC shared instance parameterfile
file_path_to_ifc_shared = Filename("..\..\REVIT\IFC Shared Parameters-RevitIFCBuiltIn_ALL.txt")  # "File Path to: IFC Shared Parameters-RevitIFCBuiltIn_ALL.txt"; graph input
python_script = Python(IN[0]=file_path_to_ifc_shared)  # CPython3
# ---------- python_script.python (23 lines) ----------
#
#from Dynamo forum
#https://forum.dynamobim.com/t/set-shared-parameter-files/49712/2
#
import clr

clr.AddReference('RevitServices')
import RevitServices
from RevitServices.Persistence import DocumentManager


doc = DocumentManager.Instance.CurrentDBDocument
uidoc=DocumentManager.Instance.CurrentUIApplication.ActiveUIDocument

uiApp = DocumentManager.Instance.CurrentUIApplication
SP = uiApp.Application.SharedParametersFilename

path = IN[0]
new = []
#Do some action in a Transaction
uiApp.Application.SharedParametersFilename = path

OUT = path
# ----------------------------------------

# group: NL/SfB tabel 1
# note: https://stprodeuwmystabu002stor.blob.core.windows.net/overig/NL-SfB_Tabel_0-4_Update-V201912.xlsx
file_path_to_nl_sfb_building = Filename("..\..\REVIT\NL-SfB_Tabel_0-4_Update-V201912.xlsx")  # "File Path to: NL/SfB building code"; graph input
# note: Custom Node: Data-Shapesv.2022.2.102
worksheets = Custom[Excel.Worksheets](FilePath=file_path_to_nl_sfb_building)  # package Data-Shapes; Gets worksheet names from specified Excel workbook.
code_block_3 = CodeBlock { 2; }
getItemAtIndex = List.GetItemAtIndex(list=worksheets, index=code_block_3)

# group: Import Excel
file_from_path = FileObject(path=file_path_to_nl_sfb_building)
boolean_2 = BoolSelector(false)
importExcel = Data.ImportExcel(file=file_from_path, sheetName=getItemAtIndex, readAsStrings=boolean_2, showExcel=boolean_2)
transpose = List.Transpose(lists=importExcel)
code_block_4 = CodeBlock()
# ---------- code_block_4.designscript (3 lines) ----------
//column E (the code)
//kolom F (the description)
4..5;
# ----------------------------------------
getItemAtIndex_2 = List.GetItemAtIndex(list=transpose, index=code_block_4)
string_from_object = FromObject(obj=getItemAtIndex_2)

# group: (change if your buildingcode is somewhere else in your familyname)
code_block_5 = CodeBlock { 0; 2; }
substring = String.Substring(string=lastItem, startIndex=code_block_5.out0, length=code_block_5.out1)

# group: Filter buildingcodes based on Familyname
code_block_6 = CodeBlock { ":"; }
startsWith = String.StartsWith(string=string_from_object, searchFor=substring)
code_block_7 = CodeBlock { 0; }
getItemAtIndex_3 = List.GetItemAtIndex(list=startsWith, index=code_block_7)
filterByBoolMask = List.FilterByBoolMask(list=string_from_object@L2, mask=getItemAtIndex_3)
transpose_2 = List.Transpose(lists=filterByBoolMask.in)
join = String.Join(separator=code_block_6, string0=transpose_2)

# group: Hide part of the filtered texts you never need.
hide_constructief = BoolSelector(true)  # graph input
string_2 = StringInput("; constructief")
contains = String.Contains(string=join, searchFor=string_2)
filterByBoolMask_2 = List.FilterByBoolMask(list=join, mask=contains)
if_ = RefactoredIf(test=hide_constructief, true=filterByBoolMask_2.out, false=join)

# group: Choose Classification
string_3 = StringInput("Choose Classification")
file_path = Filename(".\AG_DYN_logo.jpg")
code_block_8 = CodeBlock { "Classy!"; }
flatten = List.Flatten(list=if_)
firstItem = List.FirstItem(list=flatten)
# note: Custom Node: Data-Shapesv.2022.2.102
ui_radiobuttons_data = Custom[UI.RadioButtons Data](InputName=firstItem, Keys=flatten, Values=flatten)  # package Data-Shapes; Create radio buttons input for UI.MultipleInputForm ++ .
boolean_3 = BoolSelector(true)
# note: Maxheight is needed when you create a list with a lot of inputs. The inputs will run off the bottom of the screen. When setting a MAxheight you get a scroll-bar instead.
code_block_9 = CodeBlock { 750; 700; }
ui_multipleinputform = Custom[UI.MultipleInputForm ++](Description_optional=string_3, Logo_optional=file_path, ButtonText_optional=code_block_8, Inputs=ui_radiobuttons_data, Toggle=boolean_3, MaxHeight_optional=code_block_9.out0, Width_optional=code_block_9.out1)  # package Data-Shapes; Create a form with multiple inputs. see www.data-shapes.net for tutorials and infos!

# group: create name and set it to the formula
string_4 = StringInput("\"")
code_block_10 = CodeBlock(choice=ui_multipleinputform.User_Inputs) { "[NL-SfB tabel 1]"+choice; }
code_block_11 = CodeBlock(apostrophe=string_4, text=code_block_10) { apostrophe+text+apostrophe; }
# note: Custom Node: Orchidv.212.3.0.8293
set = Orchid.RevitFamily.Formula.Set(familyDocument=current, parameterName=classificationCode, value=code_block_11)

# group: Set AG shared parameterfile
file_path_to_ifc_shared_2 = Filename("..\..\REVIT\AG Shared Parameters.txt")  # "File Path to: IFC Shared Parameters-RevitIFCBuiltIn_ALL.txt"; graph input
code_block_12 = CodeBlock(passthrough=file_path_to_ifc_shared_2, waitfor=set) { [passthrough,waitfor][0]; }
python_script_2 = Python(IN[0]=code_block_12)  # CPython3; same code as python_script
