# Dynamo graph PAR_NL-SfB_project.dyn (Dynamo 2.12.0.5650)
# packages: Data-Shapes 2019.2.42, Rhythm 2020.2.13, Clockwork for Dynamo 2.x 2.3.0

# group: input dialogbox 1
file_path = Filename(".\AG_DYN_logo.jpg")
code_block = CodeBlock { "next"; }
string = StringInput("Select one model element")
string_2 = StringInput("""Then choose what you want to classify:
- this element
- all of its instances
- the FamilyType""")
# note: Custom Node: Data-Shapes v.2019.2.42
ui_textnote_data = Custom[UI.TextNote Data](Title=string, TextNote=string_2)  # package Data-Shapes; Create Data for TextNote input in UI.MultipleInputForm ++ . Check out www.data-shapes.net for more informations
code_block_2 = CodeBlock { "Select element"; }
categories = StringInput("""Ceilings
Floors
Roofs
Walls""")  # graph input
string_3 = StringInput("\n")
split = String.Split(string=categories, separator0=string_3)
byName = Category.ByName(name=split)
select_single_element = BoolSelector(true)  # graph input
ui_selectmodelelements_data = Custom[UI.SelectModelElements Data](ButtonText=code_block_2, CategoryFilter=byName, SelectSingleElement=select_single_element)  # package Data-Shapes; Creates a Revit element selection input for UI.MultipleInputForm++ . Check out www.data-shapes.net for more infos!
string_4 = StringInput("""one element
all elements of selected
Family Type of selected""")
string_5 = StringInput("\n")
split_2 = String.Split(string=string_4, separator0=string_5)
code_block_3 = CodeBlock { [0,1,2]; 2; }
ui_radiobuttons_data = Custom[UI.RadioButtons Data](Keys=split_2, Values=code_block_3.out0, DefaultValueIndex=code_block_3.out1)  # package Data-Shapes; Create radio buttons input for UI.MultipleInputForm ++ .
list_create = List.Create(item0=ui_textnote_data, item1=ui_selectmodelelements_data, item2=ui_radiobuttons_data)
boolean = BoolSelector(true)
code_block_4 = CodeBlock { 750; 400; }
ui_multipleinputform = Custom[UI.MultipleInputForm ++](Logo_optional=file_path, ButtonText_optional=code_block, Inputs=list_create, Toggle=boolean, MaxHeight_optional=code_block_4.out0, Width_optional=code_block_4.out1)  # package Data-Shapes; Create a form with multiple inputs. see www.data-shapes.net for tutorials and infos!

code_block_5 = CodeBlock { 0; 1; }
# note: get selected element
getItemAtIndex = List.GetItemAtIndex(list=ui_multipleinputform.User_Inputs, index=code_block_5.out0)
# note: Custom Node: Clockwork v.2.3.0
allInstances = Custom[Element.AllInstances](element=getItemAtIndex)  # package Clockwork for Dynamo 2.x; Retrieves all instances of a given element
elementType = Element.ElementType(element=getItemAtIndex)
# note: get choice of one, all, type
getItemAtIndex_2 = List.GetItemAtIndex(list=ui_multipleinputform.User_Inputs, index=code_block_5.out1)

# group: ClassificationCode or ClassificationCode[Type]
classificationcode = StringInput("ClassificationCode(4)")  # graph input
code_block_6 = CodeBlock(code=classificationcode) { code+"[Type]"; }
# note: Use the instance-parameter for one element or all instances of that element. When classifying the FamilyType, use the Type-parameter.
list_create_2 = List.Create(item0=classificationcode, item1=classificationcode, item2=code_block_6)
getItemAtIndex_3 = List.GetItemAtIndex(list=list_create_2, index=getItemAtIndex_2)

# group: empty Assembly Code and ClassificationCode(..)[Type]
# note: No matter what, Assembly Code will not be used anymore. So we can empty that parameter.
# No matter what the choice, we can empty the Type-parameter. If the choice is ine or all elements, the type should be empty. If Type is chosen, it doesn't matter if it's emptied, it will be filled again anyway.
code_block_7 = CodeBlock { "Assembly Code"; }
join = List.Join(list0=code_block_7, list1=code_block_6)
code_block_8 = CodeBlock { " "; }
# note: Custom Node: Rhythm v.2020.2.13
ʳʰʸᵗʰᵐ_elements = Rhythm.Revit.Elements.Elements.SetParameterByNameTypeOrInstance(element=elementType, parameterName=join, value=code_block_8, lacing=Longest)

list_create_3 = List.Create(item0=getItemAtIndex, item1=allInstances, item2=ʳʰʸᵗʰᵐ_elements)
getItemAtIndex_4 = List.GetItemAtIndex(list=list_create_3, index=getItemAtIndex_2)

# group: NL/SfB tabel 1
# note: https://stprodeuwmystabu002stor.blob.core.windows.net/overig/NL-SfB_Tabel_0-4_Update-V201912.xlsx
file_path_to_nl_sfb_building = Filename("..\..\REVIT\NL-SfB_Tabel_0-4_Update-V201912.xlsx")  # "File Path to: NL/SfB building code"; graph input
# note: Custom Node: Data-Shapes v.2019.2.42
worksheets = Custom[Excel.Worksheets](FilePath=file_path_to_nl_sfb_building)  # package Data-Shapes; Gets worksheet names from specified Excel workbook.
code_block_9 = CodeBlock { 2; }
getItemAtIndex_5 = List.GetItemAtIndex(list=worksheets, index=code_block_9)

# group: Import Excel
file_from_path = FileObject(path=file_path_to_nl_sfb_building)
boolean_2 = BoolSelector(false)
importExcel = Data.ImportExcel(file=file_from_path, sheetName=getItemAtIndex_5, readAsStrings=boolean_2, showExcel=boolean_2)
transpose = List.Transpose(lists=importExcel)
code_block_10 = CodeBlock()
# ---------- code_block_10.designscript (3 lines) ----------
//column E (the code)
//kolom F (the description)
4..5;
# ----------------------------------------
getItemAtIndex_6 = List.GetItemAtIndex(list=transpose, index=code_block_10)
string_from_object = FromObject(obj=getItemAtIndex_6)

# group: get first 2 characters. (change if your buildingcode is somewhere else in your TypeName)
name = Element.Name(element=elementType)
code_block_11 = CodeBlock { 0; 2; }
substring = String.Substring(string=name, startIndex=code_block_11.out0, length=code_block_11.out1)

# group: Filter buildingcodes based on Familyname
code_block_12 = CodeBlock { ":"; }
startsWith = String.StartsWith(string=string_from_object, searchFor=substring)
code_block_13 = CodeBlock { 0; }
getItemAtIndex_7 = List.GetItemAtIndex(list=startsWith, index=code_block_13)
filterByBoolMask = List.FilterByBoolMask(list=string_from_object@L2, mask=getItemAtIndex_7)
transpose_2 = List.Transpose(lists=filterByBoolMask.in)
join_2 = String.Join(separator=code_block_12, string0=transpose_2)

# group: Hide part of the filtered texts you never need.
hide_constructief = BoolSelector(true)  # graph input
string_6 = StringInput("; constructief")
contains = String.Contains(string=join_2, searchFor=string_6)
filterByBoolMask_2 = List.FilterByBoolMask(list=join_2, mask=contains)
if_ = RefactoredIf(test=hide_constructief, true=filterByBoolMask_2.out, false=join_2)

# group: Choose Classification
string_7 = StringInput("Choose Classification")
file_path_2 = Filename(".\AG_DYN_logo.jpg")
code_block_14 = CodeBlock { "Classy!"; }
flatten = List.Flatten(list=if_)
firstItem = List.FirstItem(list=flatten)
# note: Custom Node: Data-Shapes v.2019.2.42
ui_radiobuttons_data_2 = Custom[UI.RadioButtons Data](InputName=firstItem, Keys=flatten, Values=flatten)
boolean_3 = BoolSelector(true)
# note: Maxheight is needed when you create a list with a lot of inputs. The inputs will run off the bottom of the screen. When setting a MAxheight you get a scroll-bar instead.
code_block_15 = CodeBlock { 750; 700; }
ui_multipleinputform_2 = Custom[UI.MultipleInputForm ++](Description_optional=string_7, Logo_optional=file_path_2, ButtonText_optional=code_block_14, Inputs=ui_radiobuttons_data_2, Toggle=boolean_3, MaxHeight_optional=code_block_15.out0, Width_optional=code_block_15.out1)
code_block_16 = CodeBlock(choice=ui_multipleinputform_2.User_Inputs) { "[NL-SfB tabel 1]"+choice; }

# group: Classy!
# note: Custom Node: Rhythm v.2020.2.13
ʳʰʸᵗʰᵐ_elements_2 = Rhythm.Revit.Elements.Elements.SetParameterByNameTypeOrInstance(element=getItemAtIndex_4, parameterName=getItemAtIndex_3, value=code_block_16, lacing=Longest)

# group: empty instance ClassificationCode if needed
code_block_17 = CodeBlock { 0; }
eq = getItemAtIndex_2 == code_block_17
# note: Only if one element is selected the ClassificationCode is not emptied. Otherwise it is. If the choice is all elements it's ok that it's emtied,m it will be fille dagain. If the type is chosen the instance need te be emptied otherwise the double information might contradict eachother.
empty = List.Empty()
# note: Custom Node: Clockwork v.2.3.0
scopeIf = Custom[ScopeIf+](test=eq, True=empty, False=allInstances)  # package Clockwork for Dynamo 2.x; A (hopefully) more robust implementation of ScopeIf. Tests a single boolean and returns a value accordingly.
code_block_18 = CodeBlock { " "; }
# note: Custom Node: Rhythm v.2020.2.13
ʳʰʸᵗʰᵐ_elements_3 = Rhythm.Revit.Elements.Elements.SetParameterByNameTypeOrInstance(element=scopeIf, parameterName=classificationcode, value=code_block_18, lacing=Longest)
